# Dynamo graph DynSweeper.dyn (Dynamo 2.6.1.8786)
# packages: Genius Loci 2021.6.16, Clockwork for Dynamo 1.x 1.0.2, archi-lab.net 2021.25.2621

# group: Original code
# note: This is the original code I based the game on. :)
# https://www.askpython.com/python/examples/create-minesweeper-using-python
ORIGINAL = Python()  # unwired: IN[0]
# ---------- ORIGINAL.python (343 lines) ----------
#From https://www.askpython.com/python/examples/create-minesweeper-using-python
# Importing packages
import random
import os
 
# Printing the Minesweeper Layout
def print_mines_layout():
 
    global mine_values
    global n
 
    print()
    print("\t\t\tMINESWEEPER\n")
 
    st = "   "
    for i in range(n):
        st = st + "     " + str(i + 1)
    print(st)   
 
    for r in range(n):
        st = "     "
        if r == 0:
            for col in range(n):
                st = st + "______" 
            print(st)
 
        st = "     "
        for col in range(n):
            st = st + "|     "
        print(st + "|")
         
        st = "  " + str(r + 1) + "  "
        for col in range(n):
            st = st + "|  " + str(mine_values[r][col]) + "  "
        print(st + "|") 
 
        st = "     "
        for col in range(n):
            st = st + "|_____"
        print(st + '|')
 
    print()
  
# Function for setting up Mines
def set_mines():
 
    global numbers
    global mines_no
    global n
 
    # Track of number of mines already set up
    count = 0
    while count < mines_no:
 
        # Random number from all possible grid positions 
        val = random.randint(0, n*n-1)
 
        # Generating row and column from the number
        r = val // n
        col = val % n
 
        # Place the mine, if it doesn't already have one
        if numbers[r][col] != -1:
            count = count + 1
            numbers[r][col] = -1
 
# Function for setting up the other grid values
def set_values():
 
    global numbers
    global n
 
    # Loop for counting each cell value
    for r in range(n):
        for col in range(n):
 
            # Skip, if it contains a mine
            if numbers[r][col] == -1:
                continue
 
            # Check up  
            if r > 0 and numbers[r-1][col] == -1:
                numbers[r][col] = numbers[r][col] + 1
            # Check down    
            if r < n-1  and numbers[r+1][col] == -1:
                numbers[r][col] = numbers[r][col] + 1
            # Check left
            if col > 0 and numbers[r][col-1] == -1:
                numbers[r][col] = numbers[r][col] + 1
            # Check right
            if col < n-1 and numbers[r][col+1] == -1:
                numbers[r][col] = numbers[r][col] + 1
            # Check top-left    
            if r > 0 and col > 0 and numbers[r-1][col-1] == -1:
                numbers[r][col] = numbers[r][col] + 1
            # Check top-right
            if r > 0 and col < n-1 and numbers[r-1][col+1] == -1:
                numbers[r][col] = numbers[r][col] + 1
            # Check below-left  
            if r < n-1 and col > 0 and numbers[r+1][col-1] == -1:
                numbers[r][col] = numbers[r][col] + 1
            # Check below-right
            if r < n-1 and col < n-1 and numbers[r+1][col+1] == -1:
                numbers[r][col] = numbers[r][col] + 1
 
# Recursive function to display all zero-valued neighbours  
def neighbours(r, col):
     
    global mine_values
    global numbers
    global vis
 
    # If the cell already not visited
    if [r,col] not in vis:
 
        # Mark the cell visited
        vis.append([r,col])
 
        # If the cell is zero-valued
        if numbers[r][col] == 0:
 
            # Display it to the user
            mine_values[r][col] = numbers[r][col]
 
            # Recursive calls for the neighbouring cells
            if r > 0:
                neighbours(r-1, col)
            if r < n-1:
                neighbours(r+1, col)
            if col > 0:
                neighbours(r, col-1)
            if col < n-1:
                neighbours(r, col+1)    
            if r > 0 and col > 0:
                neighbours(r-1, col-1)
            if r > 0 and col < n-1:
                neighbours(r-1, col+1)
            if r < n-1 and col > 0:
                neighbours(r+1, col-1)
            if r < n-1 and col < n-1:
                neighbours(r+1, col+1)  
 
        # If the cell is not zero-valued            
        if numbers[r][col] != 0:
                mine_values[r][col] = numbers[r][col]
 
# Function for clearing the terminal
def clear():
    os.system("clear")      
 
# Function to display the instructions
def instructions():
    print("Instructions:")
    print("1. Enter row and column number to select a cell, Example \"2 3\"")
    print("2. In order to flag a mine, enter F after row and column numbers, Example \"2 3 F\"")
 
# Function to check for completion of the game
def check_over():
    global mine_values
    global n
    global mines_no
 
    # Count of all numbered values
    count = 0
 
    # Loop for checking each cell in the grid
    for r in range(n):
        for col in range(n):
 
            # If cell not empty or flagged
            if mine_values[r][col] != ' ' and mine_values[r][col] != 'F':
                count = count + 1
     
    # Count comparison          
    if count == n * n - mines_no:
        return True
    else:
        return False
 
# Display all the mine locations                    
def show_mines():
    global mine_values
    global numbers
    global n
 
    for r in range(n):
        for col in range(n):
            if numbers[r][col] == -1:
                mine_values[r][col] = 'M'
 
 
if __name__ == "__main__":
 
    # Size of grid
    n = 8
    # Number of mines
    mines_no = 8
 
    # The actual values of the grid
    numbers = [[0 for y in range(n)] for x in range(n)] 
    # The apparent values of the grid
    mine_values = [[' ' for y in range(n)] for x in range(n)]
    # The positions that have been flagged
    flags = []
 
    # Set the mines
    set_mines()
 
    # Set the values
    set_values()
 
    # Display the instructions
    instructions()
 
    # Variable for maintaining Game Loop
    over = False
         
    # The GAME LOOP 
    while not over:
        print_mines_layout()
 
        # Input from the user
        inp = input("Enter row number followed by space and column number = ").split()
         
        # Standard input
        if len(inp) == 2:
 
            # Try block to handle errant input
            try: 
                val = list(map(int, inp))
            except ValueError:
                clear()
                print("Wrong input!")
                instructions()
                continue
 
        # Flag input
        elif len(inp) == 3:
            if inp[2] != 'F' and inp[2] != 'f':
                clear()
                print("Wrong Input!")
                instructions()
                continue
 
            # Try block to handle errant input  
            try:
                val = list(map(int, inp[:2]))
            except ValueError:
                clear()
                print("Wrong input!")
                instructions()
                continue
 
            # Sanity checks 
            if val[0] > n or val[0] < 1 or val[1] > n or val[1] < 1:
                clear()
                print("Wrong input!")
                instructions()
                continue
 
            # Get row and column numbers
            r = val[0]-1
            col = val[1]-1 
 
            # If cell already been flagged
            if [r, col] in flags:
                clear()
                print("Flag already set")
                continue
 
            # If cell already been displayed
            if mine_values[r][col] != ' ':
                clear()
                print("Value already known")
                continue
 
            # Check the number for flags    
            if len(flags) < mines_no:
                clear()
                print("Flag set")
 
                # Adding flag to the list
                flags.append([r, col])
                 
                # Set the flag for display
                mine_values[r][col] = 'F'
                continue
            else:
                clear()
                print("Flags finished")
                continue    
 
        else: 
            clear()
            print("Wrong input!")   
            instructions()
            continue
             
 
        # Sanity checks
        if val[0] > n or val[0] < 1 or val[1] > n or val[1] < 1:
            clear()
            print("Wrong Input!")
            instructions()
            continue
             
        # Get row and column number
        r = val[0]-1
        col = val[1]-1
 
        # Unflag the cell if already flagged
        if [r, col] in flags:
            flags.remove([r, col])
 
        # If landing on a mine --- GAME OVER    
        if numbers[r][col] == -1:
            mine_values[r][col] = 'M'
            show_mines()
            print_mines_layout()
            print("Landed on a mine. GAME OVER!!!!!")
            over = True
            continue
 
        # If landing on a cell with 0 mines in neighboring cells
        elif numbers[r][col] == 0:
            vis = []
            mine_values[r][col] = '0'
            neighbours(r, col)
 
        # If selecting a cell with atleast 1 mine in neighboring cells  
        else:   
            mine_values[r][col] = numbers[r][col]
 
        # Check for game completion 
        if(check_over()):
            show_mines()
            print_mines_layout()
            print("Congratulations!!! YOU WIN")
            over = True
            continue
        clear() 
        
OUT = "original"
# ----------------------------------------

# group: Revit project information
code_block = CodeBlock { "Project Information"; }
byName = Category.ByName(name=code_block)
all_elements_of_category = ElementsOfCategory(Category=byName)

code_block_2 = CodeBlock(ProjectInfo=all_elements_of_category) { ProjectInfo; }
code_block_3 = CodeBlock(ProjectInfo=code_block_2) { ProjectInfo; }
code_block_4 = CodeBlock(ProjectInfo=code_block_3) { ProjectInfo; }

# group: Revit project name
code_block_5 = CodeBlock { "Project Name"; }
getParameterValueByName = Element.GetParameterValueByName(element=code_block_2, parameterName=code_block_5)

code_block_6 = CodeBlock(runme=getParameterValueByName) { runme[0] == "DynSweeper"? true: false; }

# group: User Input #2
square_choose_user_input = Python(IN[0]=code_block_6)
# ---------- square_choose_user_input.python (129 lines) ----------
import clr
clr.AddReference('ProtoGeometry')
from Autodesk.DesignScript.Geometry import *
clr.AddReference('RevitAPI')
import Autodesk
from Autodesk.Revit.DB import *
clr.AddReference('RevitNodes')
import Revit
clr.ImportExtensions(Revit.GeometryConversion)
clr.AddReference('RevitAPIUI')
from Autodesk.Revit.UI import *
from Autodesk.Revit.UI.Selection import *
clr.AddReference('RevitServices')
import RevitServices
from RevitServices.Persistence import DocumentManager
clr.AddReference('System.Windows.Forms')
from System.Windows.Forms import *
clr.AddReference("System.Drawing")
from System.Drawing import *

doc = DocumentManager.Instance.CurrentDBDocument
uidoc = DocumentManager.Instance.CurrentUIApplication.ActiveUIDocument

class DynSweeperForm(Form):
    def __init__(self):
        self.Text = "DynSweeper"
        self.Width = 385
        self.Height = 225
        self.TopMost = True
        self.StartPosition = FormStartPosition.CenterScreen
        self.BackColor = Color.Cornsilk

        PlayLabel = Label()
        PlayLabel.Text = "Pick your action then click a square in Revit\n\nI want to:" 
        PlayLabel.Font = Font(PlayLabel.Font.Name, 12)
        PlayLabel.ForeColor = Color.DimGray
        PlayLabel.Width = 350
        PlayLabel.Height = 60
        PlayLabel.Location = Point(10, 15)
        PlayLabel.TextAlign = ContentAlignment.MiddleCenter

        ResetLabel = Label()
        ResetLabel.Text = "Or you can"
        ResetLabel.Font = Font(ResetLabel.Font.Name, 12)
        ResetLabel.ForeColor = Color.Red
        ResetLabel.Width = 90
        ResetLabel.Height = 35
        ResetLabel.Location = Point(70, 151)

        play_button = Button()
        play_button.Text = "Uncover"
        play_button.Width = 150
        play_button.Height = 35
        play_button.Location = Point(200, 95)
        play_button.BackColor = Color.Blue
        play_button.ForeColor = Color.White
        play_button.Font = Font(play_button.Font.Name, 16)
        play_button.Click += self.play_click

        reset_button = Button()
        reset_button.Text = "Reset"
        reset_button.Width = 70
        reset_button.Height = 25
        reset_button.BackColor = Color.Crimson
        reset_button.Location = Point(160,150)
        reset_button.Click += self.reset_click
        
        mark_mine_button = Button()
        mark_mine_button.Text = "Flag"
        mark_mine_button.Width = 150
        mark_mine_button.Height = 35
        mark_mine_button.Location = Point(20, 95)
        mark_mine_button.BackColor = Color.Green
        mark_mine_button.ForeColor = Color.White
        mark_mine_button.Font = Font(mark_mine_button.Font.Name, 16)
        mark_mine_button.Click += self.mark_mine_click
        
        separator = Label()
        separator.Size = Size(400,2)
        separator.Location = Point(0,140)
        separator.BackColor = Color.Black  # Set the color of the line

        self.Controls.Add(PlayLabel)
        self.Controls.Add(ResetLabel)
        self.Controls.Add(play_button)
        self.Controls.Add(reset_button)
        self.Controls.Add(separator)
        self.Controls.Add(mark_mine_button)
        
        self.selected_action = None
        self.selected_point = None

    def play_click(self, sender, args):
        self.selected_action = "PLAY"
        self.Hide()
        try:
            pt = uidoc.Selection.PickPoint()
            self.selected_point = pt.ToPoint()
        except:
            pass
        self.Close()

    def reset_click(self, sender, args):
        self.selected_action = "RESET"
        self.Close()
        
    def mark_mine_click(self, sender, args):
        self.selected_action = "MARK_MINE"
        self.Hide()
        try:
            pt = uidoc.Selection.PickPoint()
            self.selected_point = pt.ToPoint()
        except:
            pass
        self.Close()

if IN[0] == True:
    form = DynSweeperForm()
    form.Show()

    while form.Visible:
        Application.DoEvents()

    if form.selected_action == "RESET":
        OUT = "RESET"
    elif form.selected_action == "PLAY":
        OUT = "PLAY", form.selected_point
    elif form.selected_action == "MARK_MINE":
        OUT =  "MARK", form.selected_point
# ----------------------------------------

# group: Get filled regions
code_block_7 = CodeBlock()
# ---------- code_block_7.designscript (3 lines) ----------
DSCore.Types
.FindTypeByNameInAssembly
("FilledRegion","RevitAPI");
# ----------------------------------------
all_elements_of_type = ElementsOfType(element_type=code_block_7)

# group: Filled region comments + Marks
code_block_8 = CodeBlock { ["Comments", "Mark"]; }
getParameterValueByName_2 = Element.GetParameterValueByName(element=all_elements_of_type@L2, parameterName=code_block_8, lacing=Longest)

code_block_9 = CodeBlock(runme=getParameterValueByName, ProjectInfo=code_block_3) { runme[0] == "DynSweeper"? ProjectInfo: ""; }

# group: Get numbers and grid size from Revit
code_block_10 = CodeBlock { ["Project Status", "Project Number"]; }
getParameterValueByName_3 = Element.GetParameterValueByName(element=code_block_9, parameterName=code_block_10, lacing=Longest)
code_block_11 = CodeBlock(i=getParameterValueByName_3) { i[0]; ","; i[1]; }

code_block_12 = CodeBlock(FR_comments=getParameterValueByName_2, Nums=code_block_11.out0, Grid_Size=code_block_11.out2) { FR_comments; Nums; Grid_Size; }
code_block_13 = CodeBlock(i=code_block_12.FR_comments) { i; }
code_block_14 = CodeBlock(i=code_block_12.Nums) { i; }
# note: IN
# [0] Filled Region comments
# [1] numbers
# [2] grid size
# [3] boom
code_block_15 = CodeBlock(i=code_block_12.Grid_Size) { i; }
code_block_16 = CodeBlock(Filled_Regions=all_elements_of_type) { Filled_Regions; }

# group: Filled region geometry
# note: Custom Node: archilab v.2021.25.2621
filled_region_boundary_curves = Custom[Filled Region Boundary Curves](filledRegion=code_block_16)  # package archi-lab.net; This node will get the boundary curves for a filled region.
startPoint = Curve.StartPoint(curve=filled_region_boundary_curves)
byPoints = Polygon.ByPoints(points=startPoint)
flatten = List.Flatten(list=byPoints)

code_block_17 = CodeBlock(i=square_choose_user_input) { Instruction = i[0]; ThePoint = i[1]; }
code_block_18 = CodeBlock(ThePoint=code_block_17.ThePoint) { ThePoint; }

# group: Which square chosen?
containmentTest = Polygon.ContainmentTest(polygon=flatten, point=code_block_18)
# note: Which index was clicked on?
python_script = Python(IN[0]=containmentTest)
# ---------- python_script.python (4 lines) ----------
for index, value in enumerate(IN[0]):
	if value == True:
		OUT = index
	
# ----------------------------------------

code_block_19 = CodeBlock(Instruction=code_block_17.Instruction) { Instruction; }

# group: BOOM, clear and numbers
split = String.Split(str=code_block_11.out0, separator0=code_block_11.out1)
toNumber = String.ToNumber(str=split)
toNumber_2 = String.ToNumber(str=code_block_11.out2)
chop = List.Chop(list=toNumber, lengths=toNumber_2)
# note: OUT =
# [0] uncovered_cells/ BOOM
# [1]  cells to number  / Bomb location
mines_and_numbers = Python(IN[0]=chop, IN[1]=toNumber_2, IN[2]=python_script, IN[3]=code_block_19)
# ---------- mines_and_numbers.python (61 lines) ----------
import os

numbers = IN[0]
n = IN[1]
val = IN[2]
r = val // n
col = val % n
instruction = IN[3]

# Recursive function to display all zero-valued neighbours  
def neighbours(r, col, vis):     
    if [r, col] not in vis:
        vis.append([r, col])
        
        if numbers[r][col] == 0:
            for dr in range(-1, 2):
                for dc in range(-1, 2):
                    new_r = r + dr
                    new_col = col + dc
                    if 0 <= new_r < n and 0 <= new_col < n:
                        neighbours(new_r, new_col, vis)

# Function to show all mines on the board
def show_mines(numbers, n):
    mine_locations = []
    for r in range(n):
        for col in range(n):
            if numbers[r][col] == -1:
                mine_index = r * n + col
                mine_locations.append(mine_index)
    #clear()
    return mine_locations

uncovered_cells = []
adjacent_cells = []

if numbers[r][col] == -1:	
	#Check to see if the MARK function has been used
	if instruction == "MARK": 
		OUT = instruction , val, "f"
#Check to see if the MARK function has been used
	else:
	    mine_locations = show_mines(numbers, n)
	    OUT = "BOOM", mine_locations
else:
	#Check to see if the MARK function has been used
	if instruction == "MARK": 
		OUT = instruction , val
	else: 
	    vis = []
	    neighbours(r, col, vis)
	
	    for cell in vis:
	        r, col = cell
	        cell_index = r * n + col
	        if numbers[r][col] == 0:
	            uncovered_cells.append(cell_index)
	        elif numbers[r][col] != -1:
	            adjacent_cells.append(cell_index)
	
	    OUT =  uncovered_cells ,adjacent_cells
# ----------------------------------------

# group: Win / lose pop up
python_script_2 = Python(IN[0]=code_block_13, IN[1]=code_block_14, IN[2]=code_block_15, IN[3]=mines_and_numbers)
# ---------- python_script_2.python (44 lines) ----------
FR_comments = IN[0][0]
FR_Marks = IN[0][1]
nums = IN[1]
squares = int(IN[2]) * int(IN[2])
boom = IN[3]

# How many bombs are there?
bomb = nums.count("-1")

# Find the flag indexes
flags = []
for idx, u in enumerate(FR_comments):
    if u == "f":
        flags.append(idx)

marks = 0
for x in FR_Marks:
    if x == "X":
        marks += 1

if boom[0] == "BOOM":
    OUT = "BOOM", flags
elif boom[0] == "MARK":
    if len(flags) == bomb - 1:
        if marks == len(flags):
            if boom[2] == "f":
                OUT = "win"
elif len(flags) == bomb:
	OUT = "win"    
else:
    # How many squares have been uncovered?
    uncover = 0
    for u in FR_comments:
        if u == "u":
            uncover += 1

    # Count squares in boom:
    new = len(boom[0]) + len(boom[1])

    # Is the game won?
    if (squares - bomb) == (uncover + new):
        OUT = "win"
    else:
        OUT = "not win", len(flags)
# ----------------------------------------
python_script_3 = Python(IN[0]=python_script_2)
# ---------- python_script_3.python (73 lines) ----------
import clr
clr.AddReference("System.Windows.Forms")
clr.AddReference("System.Drawing")
import System
from System.Windows.Forms import *
from System.Drawing import *
from System.Net import *
from System.IO import MemoryStream

input = IN[0]

if "not win" in input:
	run = False
elif "win" in input:
	run = True
	button = "Reset please"
	message = "      ***WINNER*** \n\n      You're a hero! \n\n      o(≧∇≦o)"
elif "BOOM" in input:
	run = True
	button = "Show me the mines"
	message = "   ***YOU LOSE*** \n\nYou blew yourself up\n\n ヽ(°〇°)ﾉ"

class CreateWindow(Form):
	def __init__(self):
		self.Name = "Create Window"
		self.Text = "©DynSweeper 2023!"
		self.Size = Size(270, 250)
		self.CenterToScreen()
		        
		label = Label(Text = message)
		label.Parent = self
		label.Location = Point(22, 20)
		label.AutoSize = False
		label.Height = 130
		label.Width = 400
		label.ForeColor = Color.Crimson
		label.Font = Font(label.Font.Name, 16) # set font size to 16
				                
		self.button = Button()
		self.button.Parent = self
		self.button.Text = button
		self.button.Location = Point(45, 170)
		self.button.Width = 180
		self.button.Height = 30
		self.button.Click += self.ButtonClicked
		self.button.BackColor = Color.Crimson
		self.button.ForeColor = Color.White     
		self.button.Font = Font(label.Font.Name, 12) # set font size
		
		# Create Bottom Line
		self.bottom_line = Label()
		self.bottom_line.Parent = self
		self.bottom_line.Location = Point(0, 155)
		self.bottom_line.Size = Size(300, 3)
		self.bottom_line.BorderStyle = BorderStyle.FixedSingle
		self.bottom_line.ForeColor = Color.Black
	
		# Make the form always on top
		self.TopMost = True
	
	def ButtonClicked(self, sender, args):
		if sender == self.button:
			if input == "win":
				self.output = "RESET"
			elif input == "BOOM":
				self.output = None
			self.Close()
	
# Call the form
if run :
	form = CreateWindow()
	Application.Run(form)
	OUT = form.output
# ----------------------------------------

code_block_20 = CodeBlock(reset=python_script_3) { reset; }

# group: USER input #setup
# note: Gate to swap between first and other
code_block_21 = CodeBlock(runme=getParameterValueByName) { runme[0] == "DynSweeper"? false: true; }
python_script_4 = Python(IN[0]=code_block_21)
# ---------- python_script_4.python (136 lines) ----------
import clr
clr.AddReference("System.Windows.Forms")
clr.AddReference("System.Drawing")
import System
from System.Windows.Forms import *
from System.Drawing import *
from System.Net import *
from System.IO import MemoryStream

runme = IN[0]

class CreateWindow(Form):
	def __init__(self):
		self.Name = "Create Window"
		self.Text = "©DynSweeper 2023!"
		self.Size = Size(450, 320)
		self.CenterToScreen()
                
		label = Label(Text = "Welcome to ©DynSweeper 2023!")
		label.Parent = self
		label.Location = Point(22, 20)
		label.AutoSize = False
		label.Height = 25
		label.Width = 400
		label.ForeColor = Color.Crimson
		label.Font = Font(label.Font.Name, 16) # set font size to 16
		
		#First image		
		picBox = PictureBox()
		picBox.SizeMode = PictureBoxSizeMode.AutoSize
		picBox.Location = System.Drawing.Point(25, 60)
        
		# Download the image from a URL
		imagePath = r"https://github.com/MoosiestMoose/DynSweeper/blob/8019195a4ecf82b09de2c8a50d71ee8b33f81066/DynSweeper_L.png?raw=true"
		client = WebClient()
		data = client.DownloadData(imagePath)
        
		# Create a memory stream from the downloaded data
		memoryStream = MemoryStream(data)
        
		# Set the image as the picture box's image
		image = Image.FromStream(memoryStream)
		picBox.Image = image
		
		# Add the picture box to the form
		self.Controls.Add(picBox)  
		
		label = Label(Text = "Grid size")
		label.Parent = self
		label.Location = Point(240, 80)
		label.AutoSize = False
		label.Height = 30
		label.Width = 100
		#label.ForeColor = Color.Red
		label.Font = Font(label.Font.Name, 12) # set font size
		
		label = Label(Text = "2")
		label.Parent = self
		label.Location = Point(370, 75)
		label.AutoSize = False
		label.Height = 30
		label.Width = 100
		#label.ForeColor = Color.Red
		label.Font = Font(label.Font.Name, 8) # set font size
		
		self.textbox = TextBox()
		self.textbox.Parent = self
		self.textbox.Text = "5"
		self.textbox.Location = Point(340, 80)
		self.textbox.Size = Size(30, 20)
		#self.textbox.Font = Font("Arial", 16)
		self.textbox.Multiline = True
		self.textbox.CharacterCasing = CharacterCasing.Upper        
		
		label = Label(Text = "No. of mines")
		label.Parent = self
		label.Location = Point(240, 130)
		label.AutoSize = False
		label.Height = 30
		label.Width = 100
		#label.ForeColor = Color.Red
		label.Font = Font(label.Font.Name, 12) # set font size
		
		self.textbox2 = TextBox()
		self.textbox2.Parent = self
		self.textbox2.Text = "5"
		self.textbox2.Location = Point(340, 130)
		self.textbox2.Size = Size(30, 20)
		self.textbox2.Multiline = True
		self.textbox2.CharacterCasing = CharacterCasing.Upper   
		                
		self.button = Button()
		self.button.Parent = self
		self.button.Text = "Let's clear mines!"
		self.button.Location = Point(240, 210)
		self.button.Width = 180
		self.button.Height = 30
		self.button.Click += self.ButtonClicked
		self.button.BackColor = Color.Crimson
		self.button.ForeColor = Color.White     
		self.button.Font = Font(label.Font.Name, 12) # set font size
		
		# Create Bottom Line
		self.bottom_line = Label()
		self.bottom_line.Parent = self
		self.bottom_line.Location = Point(200, 180)
		self.bottom_line.Size = Size(300, 3)
		self.bottom_line.BorderStyle = BorderStyle.FixedSingle
		self.bottom_line.ForeColor = Color.Black
		
		# Make the form always on top
		self.TopMost = True

	def ButtonClicked(self, sender, args):
		if sender == self.button:
			try:
				grid_size = int(self.textbox.Text)
				num_mines = int(self.textbox2.Text)			
				if 5 <= grid_size <= 20 and 5 <= num_mines < (grid_size * grid_size) / 2:
					self.value = (grid_size, num_mines, True)
					self.Close()
				else:
					if not 5 <= grid_size <= 20:
						MessageBox.Show("Invalid input! Grid size must be between 5 and 20. ", "Hey Dyno user, read this friendly warning message!", MessageBoxButtons.OK, MessageBoxIcon.Warning)
					elif not 5 <= num_mines < (grid_size * grid_size) / 2:
						MessageBox.Show("Invalid input! You need at least 5 mines and the total number of mines must be less than half the total squares.", "Really? Let's have a sensible number of mines please!", MessageBoxButtons.OK, MessageBoxIcon.Warning)
						
			except ValueError:
				MessageBox.Show("Numbers are required here! So close this and enter a lovely number.", "Number z0ne - letter$ and $ymbols @re not @llowed!", MessageBoxButtons.OK, MessageBoxIcon.Error)
		

# Call the form
if runme :
	form = CreateWindow()
	Application.Run(form)
	OUT = form.value
# ----------------------------------------
code_block_22 = CodeBlock(n=python_script_4) { grid = n[0]; }
mines_no = CodeBlock(n=python_script_4) { mines_no = n[1]; }

# group: Set project param in Revit #setup
# note: OUT
# [0] numbers for board
# [1] grid size
# [2] grid in chunks
python_script_5 = Python(IN[0]=code_block_22, IN[1]=mines_no)
# ---------- python_script_5.python (55 lines) ----------
import random

# Grid size n * n
n = IN[0]
# Starting point for mines
mine_values = [[0 for j in range(n)] for i in range(n)]
mines_no = IN[1]

def set_mines(mine_values, mines_no, n): 
    # Track of number of mines already set up
    count = 0
    while count < mines_no: 
        # Random number from all possible grid positions 
        val = random.randint(0, n*n-1) 
        # Generating row and column from the number
        r = val // n
        col = val % n 
        # Place the mine, if it doesn't already have one
        if mine_values[r][col] != -1:
            count = count + 1
            mine_values[r][col] = -1        
    return mine_values

mine_grid = set_mines(mine_values, mines_no, n)

# Function for setting up the other grid values
def set_values(numbers, n): 
    # Loop for counting each cell value
    for r in range(n):
        for col in range(n): 
            # Skip, if it contains a mine
            if numbers[r][col] == -1:
                continue 
            count = 0
            # The below loops will check all 8 neighbors of the current cell (r, col)
            for dr in range(-1, 2):
                for dc in range(-1, 2):
                    new_r = r + dr
                    new_col = col + dc
                    # Check if new_r and new_col are within grid boundaries
                    if 0 <= new_r < n and 0 <= new_col < n:
                        # Check if there is a mine in the neighbor cell
                        if numbers[new_r][new_col] == -1:
                            count += 1
            numbers[r][col] = count
    return numbers

numbers = set_values(mine_grid, n)
# Convert the 2D list to a single string with each number separated by a comma
output_string = ','.join([','.join(str(cell) for cell in row) for row in numbers])
# Convert the 2D list of integers to a 2D list of strings
numbers_as_strings = [[str(cell) for cell in row] for row in numbers]


OUT = output_string, str(n), numbers_as_strings
# ----------------------------------------
code_block_23 = CodeBlock(n=python_script_5) { ["Project Name", "Project Number", "Project Status"]; ["DynSweeper" , n[1] , n[0]]; }
setParameterByName = Element.SetParameterByName(element=all_elements_of_category@L1, parameterName=code_block_23.out0, value=code_block_23.out1)

code_block_24 = CodeBlock(Filled_Regions=code_block_16) { Filled_Regions; }

# group: Mines colour/ delete - Filled region
# note: If it's a bomb output the bomb locations and the colour red.
# Otherwise output uncovered squares so they can be deleted.
python_script_6 = Python(IN[0]=mines_and_numbers, IN[1]=code_block_24)
# ---------- python_script_6.python (28 lines) ----------
import clr
clr.AddReference("DSCoreNodes")
import DSCore.Color

red = DSCore.Color.ByARGB(255, 255, 0, 0)
white = DSCore.Color.ByARGB(255, 255, 255, 255)
green = DSCore.Color.ByARGB(255, 144, 238, 144)
boom = IN[0]
filled_regions = IN[1]

OUT = []

if "BOOM" in boom:
    OUT.append(boom[1])
    OUT.append(red)
elif "MARK" in boom:
    OUT.append(boom[1])
    OUT.append(green)
    OUT.append(filled_regions[boom[1]])
else:
    # Combine index numbers from boom
    combined_indices = boom[0] + boom[1]
    
    # Get the filled regions corresponding to the index numbers 
    output_filled_regions = [filled_regions[i] for i in combined_indices]
    OUT.append(boom)
    OUT.append(white)
    OUT.append(output_filled_regions)
# ----------------------------------------
code_block_25 = CodeBlock(i=python_script_6) { i[0]; i[1]; i[2]; }
getItemAtIndex = List.GetItemAtIndex(list=code_block_24, index=code_block_25.out0)
overrideColorInView = Element.OverrideColorInView(element=getItemAtIndex, color=code_block_25.out1)
code_block_26 = CodeBlock { "Comments"; }
python_script_7 = Python(IN[0]=mines_and_numbers)
# ---------- python_script_7.python (9 lines) ----------
boom = IN[0]

if "BOOM" in boom:
    OUT = ""
elif "MARK" in boom:
	if "f" in boom:
	    OUT = "f"
else:
	OUT = "u"
# ----------------------------------------
setParameterByName_2 = Element.SetParameterByName(element=code_block_25.out2@L1, parameterName=code_block_26, value=python_script_7)

# group: Revit text and lines
code_block_27 = CodeBlock { ["Lines" , "Text Notes"]; }
byName_2 = Category.ByName(name=code_block_27)
all_elements_of_category_2 = ElementsOfCategory(Category=byName_2)

code_block_28 = CodeBlock(Filled_Regions=all_elements_of_type) { Filled_Regions; }

# group: Get text note types
code_block_29 = CodeBlock()
# ---------- code_block_29.designscript (3 lines) ----------
DSCore.Types
.FindTypeByNameInAssembly
("TextNoteType","RevitAPI");
# ----------------------------------------
all_elements_of_type_2 = ElementsOfType(element_type=code_block_29)
name = Element.Name(element=all_elements_of_type_2)

# group: Reset game - Delete project name, number and status, delete filled regions, lines and text
code_block_30 = CodeBlock(UI2=square_choose_user_input) { UI2; }
python_script_8 = Python(IN[0]=code_block_30, IN[1]=code_block_20)
# ---------- python_script_8.python (4 lines) ----------
if IN[0] == "RESET":
	OUT = "Project Name", "Project Number", "Project Status"
if IN[1] == "RESET":
	OUT = "Project Name", "Project Number", "Project Status"
# ----------------------------------------
code_block_31 = CodeBlock { ""; }
setParameterByName_3 = Element.SetParameterByName(element=code_block_4, parameterName=python_script_8, value=code_block_31, lacing=Longest)
# note: IN
# [0] Point
# [1] Curves
# [2] Filled regions
# [3]  Text note types
# [4] Text note type names
# [5] RESET
# note: OUT
# Curves, Filled regions
# and text to delete
python_script_9 = Python(IN[0]=code_block_30, IN[1]=all_elements_of_category_2, IN[2]=code_block_28, IN[3]=all_elements_of_type_2, IN[4]=name, IN[5]=code_block_20)
# ---------- python_script_9.python (21 lines) ----------
curves = IN[1]
filled_regions = IN[2]
TextTypes = IN[3]
TxtNoteTypeNames = IN[4]
txt = []
check = [] 

#Get a list of strings that are -1 to 8
for num in range (-1,9):
	check.append(str(num))
	
#Create a list of text types to delete
for index, item in enumerate(TxtNoteTypeNames):
	if item in check:
		txt.append(TextTypes[index])
		
#output lists of Revit items for deletion		
if IN[0] == "RESET":
	OUT = curves, filled_regions, txt
elif IN[5] == "RESET":
	OUT = curves, filled_regions, txt
# ----------------------------------------
flatten_2 = List.Flatten(list=python_script_9)
delete = Element.Delete(element=flatten_2)

# group: Create text note types in Revit #setup
python_textnotetypes = Python(IN[0]=code_block_21)
# ---------- python_textnotetypes.python (28 lines) ----------
# Import required libraries
import clr
# Import DynamoRevit
clr.AddReference("RevitServices")
import RevitServices
from RevitServices.Persistence import DocumentManager
# Import RevitAPI
clr.AddReference("RevitAPI")
import Autodesk
from Autodesk.Revit.DB import *

# Get the active Revit document
doc = DocumentManager.Instance.CurrentDBDocument

if IN[0] == True: 
	# Get all TextNoteType elements
	text_note_types_collector = FilteredElementCollector(doc).OfClass(TextNoteType)
	text_note_types = [t for t in text_note_types_collector]
	
	# Get all TextNote elements of the TextNoteType elements
	text_notes = []
	for text_note_type in text_note_types:
	    text_notes_collector = FilteredElementCollector(doc).OfClass(TextNote).WhereElementIsNotElementType()
	    text_notes_of_type = [t for t in text_notes_collector if t.TextNoteType.Id == text_note_type.Id]
	    text_notes.extend(text_notes_of_type)
	
	# Assign the outputs to the OUT variable
	OUT = text_note_types
# ----------------------------------------
python_coloured_textnotes = Python(IN[0]=python_textnotetypes)
# ---------- python_coloured_textnotes.python (41 lines) ----------
# Import required libraries
import clr

# Import DynamoRevit
clr.AddReference("RevitServices")
import RevitServices
from RevitServices.Persistence import DocumentManager
from RevitServices.Transactions import TransactionManager

# Import RevitAPI
clr.AddReference("RevitAPI")
import Autodesk
from Autodesk.Revit.DB import *

# Get the active Revit document
doc = DocumentManager.Instance.CurrentDBDocument

# Get TextNoteType from input
text_note_type = UnwrapElement(IN[0])[0]

def duplicate_text_note_type(text_note_type, new_name, font=None, text_size=None):
    TransactionManager.Instance.EnsureInTransaction(doc)
    new_text_note_type = text_note_type.Duplicate(new_name)
    if font:
        new_text_note_type.get_Parameter(BuiltInParameter.TEXT_FONT).Set(font)
    if text_size:
        new_text_note_type.get_Parameter(BuiltInParameter.TEXT_SIZE).Set(text_size)
    TransactionManager.Instance.TransactionTaskDone()
    return new_text_note_type

# Duplicate TextNoteType 8 times with names "1" through "8"
duplicated_text_note_types = [duplicate_text_note_type(text_note_type, str(i), "Arial", 1/304.8) for i in range(1, 9)]

# Create an additional TextNoteType called "-1" with TEXT_FONT set to "Wingdings"
text_note_type_minus_1 = duplicate_text_note_type(text_note_type, "-1", "Wingdings",  1/304.8)

# Combine the duplicated text note types and the additional text note type
all_text_note_types = duplicated_text_note_types + [text_note_type_minus_1]

# Assign your output to the OUT variable.
OUT = all_text_note_types
# ----------------------------------------
code_block_32 = CodeBlock { "Color"; }
code_block_33 = CodeBlock { [16318464 , 32768 , 255 , 8388608 , 128 , 8421376 , 0 , 8421504 , 1]; }
setParameterByName_4 = Element.SetParameterByName(element=python_coloured_textnotes, parameterName=code_block_32, value=code_block_33)

# group: Current view
current = Document.Current()
activeView = Document.ActiveView(document=current)

# group: n * n Grid of squares - #Setup
code_block_34 = CodeBlock(n=code_block_22) { Point.ByCoordinates((0..#n..220)<1>, (0..#n..220)<2>); }
reverse = List.Reverse(list=code_block_34@L2)
byOrigin = CoordinateSystem.ByOrigin(origin=reverse)
code_block_35 = CodeBlock { 200; }
byWidthLength = Rectangle.ByWidthLength(cs=byOrigin, width=code_block_35, length=code_block_35)
explode = Geometry.Explode(geometry=byWidthLength)

# group: To Revit - board set up (filled regions and detail lines) #Setup
flatten_3 = List.Flatten(list=explode)
byGeometry = BoundingBox.ByGeometry(geom=flatten_3)
code_block_36 = CodeBlock(BB=byGeometry)
# ---------- code_block_36.designscript (3 lines) ----------
lowPt = BB.MinPoint;
hghPt = BB.MaxPoint;
Rectangle.ByCornerPoints(lowPt,Point.ByCoordinates(lowPt.X,hghPt.Y),hghPt,Point.ByCoordinates(hghPt.X,lowPt.Y));
# ----------------------------------------
code_block_37 = CodeBlock { 20; }
offset = Curve.Offset(curve=code_block_36.out2, distance=code_block_37)
explode_2 = Geometry.Explode(geometry=offset)
byCurve = DetailCurve.ByCurve(view=activeView, curve=explode_2)

# group: From Dynamo #Setup
python_script_10 = Python()  # unwired: IN[0]
# ---------- python_script_10.python (16 lines) ----------
import clr
clr.AddReference("RevitAPI")
from Autodesk.Revit.DB import *
clr.AddReference("RevitServices")
import RevitServices
from RevitServices.Persistence import DocumentManager

doc = DocumentManager.Instance.CurrentDBDocument
type_name = []

filled_region_types = FilteredElementCollector(doc).OfClass(FilledRegionType).ToElements()

for filled_region_type in filled_region_types:
    type_name_param = filled_region_type.get_Parameter(BuiltInParameter.SYMBOL_NAME_PARAM)
    type_name.append(type_name_param.AsString())
    OUT = filled_region_type
# ----------------------------------------
code_block_38 = CodeBlock { "<Solid fill>"; false; 1; }
# note: Grab a filled region type from Revit
getByName = FillPatternElement.GetByName(name=code_block_38.out0)
# note: Custom Node: Clockwork v.2.3.0
silver = Custom[Color.Silver]()  # package Clockwork for Dynamo 1.x; Returns the colour silver.
# note: Custom Node: GeniusLoci v.2021.6.16
filledregion_properties_change = Custom[FilledRegion Properties Change](FilledRegion_OrType=python_script_10, ForegroundPattern=getByName, ForegroundPatternColor=silver, IsMasking=code_block_38.out1, LineWeight=code_block_38.out2)  # package Genius Loci; Assigns Pattern, Color and Line Weight to the given Filled Region or to a Filled Region Type. Note : Prior to Revit 2019, the materials have only one surface pattern and one cut pattern.
byCurves = FilledRegion.ByCurves(view=activeView, boundary=explode, regionType=filledregion_properties_change)

# group: Pin elements
code_block_39 = CodeBlock(a=byCurve, b=byCurves) { [a, b]; true; }
setPinnedStatus = Element.SetPinnedStatus(element=code_block_39.out0, pinned=code_block_39.out1)

code_block_40 = CodeBlock(view=activeView) { view; }
# note: OUT =
# [0] uncovered_cells/ BOOM
# [1]  cells to number  / Bomb location
python_script_11 = Python(IN[0]=python_script_2, IN[1]=mines_and_numbers)
# ---------- python_script_11.python (6 lines) ----------
if IN[0] == None:
	OUT = IN[1]
elif "BOOM" in IN[0]:
		OUT = IN[1][0],[number for number in IN[1][1] if number not in IN[0][1]]
else:
	OUT = IN[1]
# ----------------------------------------

# group: Yeah yeah, repeated code... I know
code_block_41 = CodeBlock(n=toNumber_2) { Point.ByCoordinates((0..#n..220)<1>, (0..#n..220)<2>); }
reverse_2 = List.Reverse(list=code_block_41@L2)
flatten_4 = List.Flatten(list=reverse_2)

code_block_42 = CodeBlock(SqIndex=python_script) { SqIndex; }
code_block_43 = CodeBlock(SqIndex=code_block_42) { SqIndex; }

# group: Mines and locations of mines
code_block_44 = CodeBlock { "M"; }
count = List.Count(list=flatten_4)
ofRepeatedItem = List.OfRepeatedItem(item=code_block_44, amount=count)
code_block_45 = CodeBlock { "N"; }
replaceItemAtIndex = List.ReplaceItemAtIndex(list=ofRepeatedItem, index=code_block_43, item=code_block_45)
code_block_46 = CodeBlock(bomb=replaceItemAtIndex, location=flatten_4) { [bomb, location]; }

# group (continued): BOOM, clear and numbers
code_block_47 = CodeBlock(num=split, location=flatten_4) { [num , location]; }

# group: Uncovered cells or bombs
# note: Returns
# [0] number/bomb symbol
# [1] location
python_script_12 = Python(IN[0]=python_script_11, IN[1]=code_block_46, IN[2]=code_block_47)
# ---------- python_script_12.python (13 lines) ----------
boom = IN[0] 
mines = IN[1] 
notmines = IN[2]
flag = []

if "BOOM" in boom:
	OUT = mines
elif "MARK" in boom:
	for i in mines[0]:
		flag.append("O")
	OUT = flag, mines[1]
else:
	OUT = notmines
# ----------------------------------------
code_block_48 = CodeBlock(i=python_script_11) { i[1]; }
# note: Selects only those to display on this turn
getItemAtIndex_2 = List.GetItemAtIndex(list=python_script_12@L2, index=code_block_48)
code_block_49 = CodeBlock(i=getItemAtIndex_2) { loc = i[1]; num = i[0]; }

# group: Placement points for numbers
X = Point.X(point=code_block_49.loc)
Y = Point.Y(point=code_block_49.loc)
code_block_50 = CodeBlock(Y=Y) { Y + 80; }
byCoordinates = Point.ByCoordinates(x=X, y=code_block_50)

code_block_51 = CodeBlock(TEXT=code_block_49.num) { TEXT; }
code_block_52 = CodeBlock(Boom=python_script_11) { Boom; }
python_bomb_test = Python(IN[0]=code_block_51, IN[1]=code_block_52)
# ---------- python_bomb_test.python (9 lines) ----------
text = IN[0]
bomb_test = IN[1]

if bomb_test[0] == "BOOM":
	OUT = ["-1"] * len (text)
elif bomb_test[0] == "MARK":
	OUT = "-1"
else:
	OUT = text
# ----------------------------------------

# group: Text in Revit
code_block_53 = CodeBlock { "Center"; }
byName_3 = TextNoteType.ByName(name=python_bomb_test)
byLocation = TextNote.ByLocation(view=code_block_40, location=byCoordinates, text=code_block_51, alignment=code_block_53, type=byName_3)
code_block_54 = CodeBlock { true; }
setPinnedStatus_2 = Element.SetPinnedStatus(element=byLocation, pinned=code_block_54)

# group: Can't select pinned
python_script_13 = Python(IN[0]=code_block_21)
# ---------- python_script_13.python (21 lines) ----------
import clr
clr.AddReference('RevitAPI')
from Autodesk.Revit.DB import *
clr.AddReference('RevitServices')
from RevitServices.Persistence import DocumentManager
from RevitServices.Transactions import TransactionManager
clr.AddReference('RevitAPIUI')
from Autodesk.Revit.UI import *

doc = DocumentManager.Instance.CurrentDBDocument
uiapp = DocumentManager.Instance.CurrentUIApplication
app = uiapp.Application
uidoc = uiapp.ActiveUIDocument

if IN[0]: 
	# Get the SelectionUIOptions 
	moose = SelectionUIOptions.GetSelectionUIOptions()
	# Toggle "Select Pinned Elements"
	moose.SelectPinned = False
	
	OUT = moose.SelectPinned
# ----------------------------------------

code_block_55 = CodeBlock(i=code_block_46) { i[0]; }

# group: Getting lazy and just want this finished :D
code_block_56 = CodeBlock { "Mark"; }
code_block_57 = CodeBlock(inst=code_block_19) { inst == "MARK"? "X": ""; }
setParameterByName_5 = Element.SetParameterByName(element=code_block_25.out2@L1, parameterName=code_block_56, value=code_block_57)
